# Dynamo graph area stair.dyn (Dynamo 1.2.1.3083)

select_model_element = DSModelElementSelection()  # 1 picked in the model
geometry = Element.Geometry(select_model_element)
watch = Watch(geometry)
byUnion = Solid.ByUnion(watch)
watch_2 = Watch(byUnion)
area = Solid.Area()  # unwired: arg0
volume = Solid.Volume()  # unwired: arg0
faces = Element.Faces(select_model_element)
code_block = CodeBlock { 0.5; }
pointAtParameter = Surface.PointAtParameter(surface=faces, u=code_block, v=code_block)
normalAtPoint = Surface.NormalAtPoint(surface=faces, point=pointAtParameter)
ZAxis = Vector.ZAxis()
isAlmostEqualTo = Vector.IsAlmostEqualTo(normalAtPoint, ZAxis)
filterByBoolMask = List.FilterByBoolMask(list=faces, mask=isAlmostEqualTo)
watch_3 = Watch(filterByBoolMask.in)
area_2 = Surface.Area(watch_3)
sum = Math.Sum(area_2)
