# Dynamo graph path at topography.dyn (Dynamo 1.2.1.3083)

# note: subregion
select_model_element = DSModelElementSelection()  # 1 picked in the model
points = Topography.Points(select_model_element)
# note: floor
select_model_element_2 = DSModelElementSelection()  # 1 picked in the model
slabShapeByPoints = Custom[Floor.SlabShapeByPoints](points=points, floor=select_model_element_2)  # Transform a slab shape based on a list of XYZs. PLEASE NOTE: Will reset any previous edits on the slab shape.
